# Grasshopper definition lampshade copy.gh (Grasshopper 0.9.80)

curve = Curve(<curve referenced from the Rhino model>)
curve_2 = Curve(<curve referenced from the Rhino model>)
curve_3 = Curve(<curve referenced from the Rhino model>)
loft = Loft(
    Curves=[curve, curve_2, curve_3],
    Options={Adjust=False, Closed=False, LoftEnds=0, LoftSimp=0, LoftType=3, Rebuild=10, Refit=0.01})
deconstruct_brep = DeconstructBrep(Brep=loft)  # -> Faces, Edges, Vertices
panel = Panel(deconstruct_brep.Faces)
u_count = Slider(0, range=0..10)
v_count = Slider(215, range=0..300)
list_item = ListItem(List=deconstruct_brep.Faces, Index=Slider(1, range=0..10), Wrap=True)
surface = Surface(reparameterize(list_item))
panel_2 = Panel(surface)
divide_domain² = DivideDomain²(Domain=surface, UCount=u_count, VCount=v_count)
merge = Merge(Data1=Toggle(True), Data2=Toggle(False))
cull_pattern = CullPattern(List=surface, CullPattern=merge)
